# Grasshopper definition 20220715_A01_AerotechHexPrint.gh (Grasshopper 1.0.7)
# plug-ins: Vespidae, Kangaroo2 Components, LunchBox

# ----
# Geometry Inputs
separator_thickness_mm = Slider(0.02, range=0..0.1)
box_length_mm = Slider(10, range=0..10)
electrode_radius_mm = Slider(0.03, range=0..0.1)
hex_radius_mm = Slider(0.16, range=0..1)

colour_rgb = ColourRGB(Alpha=255, Red=0, Green=0, Blue=255)
colour_rgb_2 = ColourRGB(Alpha=255, Red=255, Green=0, Blue=0)
panel = Panel("""Anode
Cathode
Separator""")
colour_rgb_3 = ColourRGB(Alpha=120, Red=246, Green=255, Blue=0)
colour_hsv = ColourHSV(Alpha=1, Hue=0, Saturation=1, Value=1)
colour = Colour([colour_rgb_2, colour_rgb, colour_rgb_3])

panel_2 = Panel("1")

create_layers = CreateLayers(CreateToggle=Button(), LayerNames=panel, LayerColors=flatten(colour))
multiplication = Multiplication(A=separator_thickness_mm, B=2)

# ----
# Hexagon Generator
multiplication_2 = Multiplication(A=hex_radius_mm, B=1.732052)
multiplication_3 = Multiplication(A=hex_radius_mm, B=1.5)
xy = XYPlane(Origin=Point(0, 0, 0))
dom = ConstructDomain(DomainStart=0, DomainEnd=box_length_mm)
division = Division(A=box_length_mm, B=multiplication_3)
division_2 = Division(A=box_length_mm, B=multiplication_2)
rectangle = Rectangle(Plane=xy, XSize=dom, YSize=dom, Radius=0)  # -> Rectangle, Length
hexgrid = Hexagonal(Plane=rectangle.Rectangle, Size=hex_radius_mm, ExtentX=division, ExtentY=division_2)  # -> flatten(Cells), flatten(Points)
debrep = DeconstructBrep(Brep=hexgrid.Cells)  # -> Faces, flatten(Edges), Vertices
dupln = RemoveDuplicateLines(Lines=debrep.Edges, Tolerance=0.01)

subtraction = Subtraction(A=hex_radius_mm, B=multiplication)
button = Button()
Z = UnitZ(Factor=1)
pt = Point(hexgrid.Points)
circle = CircleCNR(Center=pt, Normal=Z, Radius=subtraction)
circle_2 = CircleCNR(Center=pt, Normal=Z, Radius=electrode_radius_mm)
bake = ObjectBake(
    BakeToggle=button,
    GeometryObjects=circle,
    Layer="Anode",
    ObjectName="GH_Obj",
    ObjectColor=RGB(255, 255, 255),
    LayerColor=RGB(255, 255, 255))
bake_2 = ObjectBake(
    BakeToggle=button,
    GeometryObjects=circle_2,
    Layer="Cathode",
    ObjectName="GH_Obj",
    ObjectColor=RGB(255, 255, 255),
    LayerColor=RGB(255, 255, 255))
bake_3 = ObjectBake(
    BakeToggle=button,
    GeometryObjects=circle,
    Layer="Separator",
    ObjectName="GH_Obj",
    ObjectColor=RGB(255, 255, 255),
    LayerColor=RGB(255, 255, 255))
speed_mm_min = Slider(700, range=0..1000)
speed_mm_min_2 = Slider(700, range=0..1000)
panel_3 = Panel("""$DO[0].X=1
DWELL 0.1""")
panel_4 = Panel("""$DO[0].X=1
DWELL 0.1""")
vespmove = MoveComponent(Curve=circle, Speed=speed_mm_min, ToolId="2", GcodeInjection=panel_3, GcodePostInjection="$DO[0].X=0")
vespmove_2 = MoveComponent(Curve=dupln, Speed=speed_mm_min_2, ToolId="2", GcodeInjection=panel_4, GcodePostInjection="$DO[0].X=0")
solve = SolveActionsComponent(Actions=vespmove_2, RetractHeight=Slider(0.7, range=0..5), TravelSpeed=5000, PartialRetract=Toggle(True))
panel_5 = Panel(solve)
viz_paths = VisualizePaths(Actions=solve, ArrowScl=1, ArrowDensity=1)  # -> AllMoves, Moves, Extrude, Travel, Syringe, Arrows
item = ListItem(List=viz_paths.AllMoves, Index=Slider(39, range=0..50), Wrap=True)
set_machine_parameters = Panel("""' Aerotech Control Program

' Set tool offsets (must measure manually)
#DEFINE XOff1 5
#DEFINE YOff1 25
#DEFINE ZOff1 0.1
#DEFINE XOff2 0
#DEFINE YOff2 0
#DEFINE ZOff2 0""")
footer = Panel("""DFS ResetTool
	IF ($ToolID != 0)
		LINEAR X -$XOffset Y -$YOffset Z -$ZOffset
		$ToolID = 0
	ENDIF
ENDDFS

DFS ToolChange
	IF ($T.DEFINED == 1)
		IF ($T != $ToolID)
			$ToolID = $T
			$XOffset = $X
			$YOffset = $Y
			$ZOffset = $Z
			LINEAR X $XOffset Y $YOffset Z $ZOffset
		ENDIF
		'Does nothing if you already have the right tool
	ELSE
		MSGDISPLAY 1, "Error: Command missing a parameter!"
	ENDIF
ENDDFS""")
header = Panel("""'Sets up Aerotech to run on relative coords, units in mm & mm/min
PRIMARY
MINUTES
INCREMENTAL

'sets up tool change variable
DVAR $ToolID, $XOffset, $YOffset, $ZOffset""")
crv = Curve(item)
merge = Merge(Data1=set_machine_parameters, Data2=header)
vespmoaerobasic = Vespmo_Aerobasic_Component(Actions=solve, Header=merge, Footer=footer, Absolute=True, InvertZ=True)  # -> Aerobasic, Test
absolute = Panel(vespmoaerobasic.Aerobasic)
vespmoaerobasic_2 = Vespmo_Aerobasic_Component(Actions=solve, Header=merge, Footer=footer, Absolute=False, InvertZ=True)  # -> Aerobasic, Test
relative = Panel(vespmoaerobasic_2.Aerobasic)
panel_6 = Panel(vespmoaerobasic_2.Test)
