# Grasshopper definition Example00_Movement_IntroWorkflow.gh (Grasshopper 1.0.7)
# plug-ins: Vespidae

# ----
# 1. Import Curves
# & sort
# First, we import or create curves that
# we want to turn into toolpaths.
# There are 5 input curves in the
# associated Rhino file that we are importing
pipeline = GeometryPipeline(
    GroupByLayer=False,
    GroupByType=False,
    IncludeHidden=True,
    IncludeLocked=True,
    LayerFilter="Default",
    NameFilter="*",
    SublayerFiltering=True,
    TypeFilter=4)
sort_curves = SortCurveComponent(Curves=pipeline)

# ----
# 2. Convert to Vespidae
# Move Objects
# If you are using multiple tools,
# you specify which tool number you are using here ->
# 5 input curves creates
# 5 Vespidae move objects
panel = Panel(";If you have any gcode you want to insert BEFORE you move, they go here")
panel_2 = Panel(";If you have any gcode you want to insert AFTER you move, they go here")
# Next, we start assigning movement metadata to these curves.
# In this case, we are specifying what tool these curves belong to,
# and how fast the tool should move along these curves.
tool_speed_mm_min = Slider(7118, range=0..10000)
vespmove = MoveComponent(Curve=sort_curves, Speed=tool_speed_mm_min, ToolId="0", GcodeInjection=panel, GcodePostInjection=panel_2)
panel_3 = Panel(vespmove)

# ----
# 3. Solve Travel between
# Move Components
# Then, we need to figure out how the tool should get between each of
# the move components that we just made. This produces travel
# movements between each of the move components.
# Inputs:
# Retract Height - how much the tool moves
# up during the travel actions to avoid collisions
# Travel Speed - how fast the tool travels
# Partial Retract - Determines if it retracts the
# full retract height, or just goes 0.2mm higher
# Sort - Additional sorting
# This produces 5 travel actions
# between the 5 move actions
travel_speed_mm_min = Slider(8160, range=0..10000)
retract_height_mm = Slider(14, range=0..100)
partial_retraction = BooleanToggle(False)
solve = SolveActionsComponent(
    Actions=vespmove,
    RetractHeight=retract_height_mm,
    TravelSpeed=travel_speed_mm_min,
    PartialRetract=partial_retraction,
    SortCriteria=0)
panel_4 = Panel(solve)

# ----
# 3.5. Visualize the paths
# Since everything that is produced is in Vespidae actions,
# this shows the full travel path the tool will take.
# It can be broken down into the different actions
# if you want to view them separately.
# Inputs:
# VObj - the Vespidae actions you want to view.
# Scl - Arrow size to help show directionality.
# Dens - How often the arrows will show up.
number_slider = Slider(10, range=0..10)
viz_paths = VisualizePaths(Actions=solve, ArrowScl=number_slider, ArrowDensity=1)  # -> AllMoves, Moves, Extrude, Travel, Arrows
crv = Curve(viz_paths.AllMoves)

# ----
# 4. Convert to Gcode &
# Upload to Controller
# Finally, we turn all of the actions into Gcode that
#  a machine can understand. We can also directly upload
# the Gcode to a printer, if it is connected to ethernet or the same WiFi.
# Inputs:
# VObj - the Vespidae actions you want to convert to Gcode.
# h - the header Gcode that you want to include before all the actions.
# This can be printer settings (e.g. max speed, accel, etc.)
# f - footer Gcode you want to include (e.g. shutoff procedures)
# abs - If you want the resulting Gcode to be in
# absolute coordinates or relative coordinates.
# Inputs:
# gcode - the Gcode you are uploading to the printer
# fn - Gcode filename
# ip - the IP address that you are uploading the code to
# snd - Will send when the button is pressed
vespidae_to_gcode = VespidaeGcode(Actions=solve, Absolute=False)
send = Button()
upload_gcode = UploadGcodeComponent(Gcode=vespidae_to_gcode, Filename="example_00", Ip="http://192.168.0.10", SendCode=send)
