# Grasshopper definition Example01_Movement_ModifyingSettings_GCodeInjection.gh (Grasshopper 1.0.7)
# plug-ins: Vespidae

# ----
# 1. Import Curve & Create Array
# Similar to Example 00, we can import curves from an open Rhino document.
# We can also manipulate the curves directly in Grasshopper, such as making arrays.
crv = Curve(<curve referenced from the Rhino model>)
number_slider = Slider(1, range=0..10)
number_slider_2 = Slider(3, range=0..100)
sqgrid = Square(Plane=PlaneXY(20, 20, 0), Size=Slider(31, range=0..100), ExtentX=number_slider, ExtentY=number_slider)  # -> Cells, Points
arrrec = RectangularArray(Geometry=crv, Cell=sqgrid.Cells, XCount=number_slider_2, YCount=number_slider_2)  # -> Geometry, Transform

# ----
# 2. Parameterizing Different Settings for Each Curve
# We now have a 3x3 array of circles. This section of uses a custom C# script
# to change M566 settings before each Vespidae move.
# M566 changes the max acceleration, so around curves like a
# circle, there should be an appreciable difference in behavior.
# First, we create a list with lines for the setting that we want to change.
# We can input those lines into the Move component in the gInj input.
# Combined with our curve inputs, we now have a M566 line
# inserted into each Vespidae Move action.
# For a 3x3 array, we have 9 created values.
number_slider_3 = Slider(100, range=0..100)
lng = ListLength(List=flatten(arrrec.Geometry))
series = Series(Start=Slider(100, range=0..100), Step=number_slider_3, Count=lng)  # -> flatten(Series)
# Example 1: Testing Different Settings of a Curve Array
c_script = CSharpScript(x=series)  # -> out, flatten(A); inputs x: list of Int32
# ---------- c_script: C# ----------
    var gcode = new List<string>();

    foreach(var t in x){
      string test = String.Format("M566 X{0:N} Y{1:N}", t, t);
      gcode.Add(test);
    }

    A = gcode;
# ---------- end c_script ----------
panel = Panel(c_script.A)
speed_mm_min = Slider(6000, range=0..10000)
vespmove = MoveComponent(Curve=simplify(graft(arrrec.Geometry)), Speed=speed_mm_min, GcodeInjection=simplify(graft(panel)))  # -> flatten(VespObj)

# ----
# 3. Solve Actions
# Again, Solve will produce Vespidae Travel actions between each Vespidae Move
# object so that the machine will know how to get from one curve to the next.
toggle = BooleanToggle(True)
solve = SolveActionsComponent(Actions=vespmove, RetractHeight=15, TravelSpeed=5000, PartialRetract=toggle, SortCriteria=0)
panel_2 = Panel(solve)

# ----
# 3.5. Visualize Paths
# Again, this turns Vespidae objects
# into curves that we can then see in Rhino.
viz_paths = VisualizePaths(Actions=solve, ArrowScl=1, ArrowDensity=1)  # -> AllMoves, Moves, Extrude, Travel, Arrows

# ----
# 4. Convert to GCode and Upload
# In this panel, you can see that the M566 codes that we made
# with our script have been injected at the start of each Move action.
# There are different M566 parameters at the start of every Move.
# Conversion into GCode
# Upload
vespidae_to_gcode = VespidaeGcode(Actions=solve, Absolute=False)
panel_3 = Panel(vespidae_to_gcode)
upload_gcode = UploadGcodeComponent(Gcode=vespidae_to_gcode, Filename="example_01", Ip="http://192.168.0.10", SendCode=Button())
