# Grasshopper definition Example05_Nonplanar_Printing.gh (Grasshopper 1.0.7)
# plug-ins: Vespidae

layer_height_mm = Slider(0.2, range=0..1)
infill_spacing_mm = Slider(1.1, range=0..2)
shell_layers = Slider(2, range=0..5)
offset_mm = Slider(0.4, range=0..1)
brep = Brep(<brep referenced from the Rhino model>)
crv = Curve(<curve referenced from the Rhino model>)
slice = SlicerComponent(Brep=brep, LayerHeight=layer_height_mm)  # -> SlicedPolys, SlicingPlanes
addition = Addition(A=shell_layers, B=1)
multiplication = Multiplication(A=offset_mm, B=addition)
number_slider = Slider(2.5, range=0..10)
number_slider_2 = Slider(0, range=0..3)
infill = InfillComponent(Curve=slice.SlicedPolys, Density=infill_spacing_mm, Offset=multiplication, InfillAngle=0)
sliceroffset = SlicerFriendlyOffset(Curve=slice.SlicedPolys, Offset=offset_mm, Amount=shell_layers, Keep=True)
vespextrusion = ExtrusionComponent(Curve=sliceroffset, Extrusion=number_slider, Speed=1000, Temperature=205, Retract=2, ToolId=number_slider_2, ExtType=0)
vespextrusion_2 = ExtrusionComponent(Curve=infill, Extrusion=number_slider, Speed=1000, Temperature=205, Retract=2, ToolId=number_slider_2, ExtType=1)
vespextrusion_3 = ExtrusionComponent(
    Curve=crv,
    Extrusion=Slider(3.5, range=0..10),
    Speed=1000,
    Temperature=205,
    Retract=2,
    ToolId=Slider(1, range=0..1),
    ExtType=0)
merge = Merge(Data1=vespextrusion_2, Data2=vespextrusion)
vespmove = MoveComponent(Curve=crv, Speed=1000, ToolId=0)
sortactionsdynamic = SortActionsDynamicComponent(Sort_string="ZTXY", FlipX=False, FlipY=False, FlipZ=False, FlipT=False, Actions0=merge, Actions1=vespmove)
solve = SolveActionsComponent(Actions=sortactionsdynamic, RetractHeight=15, TravelSpeed=5000, PartialRetract=False)
solve_2 = BasicSolverComponent(Actions=sortactionsdynamic, RetractHeight=15, TravelSpeed=5000, PartialRetract=False)
viz_paths = VisualizePaths(Actions=solve_2, ArrowScl=1, ArrowDensity=1)  # -> AllMoves, Moves, Extrude, Travel, Arrows
panel = Panel(solve_2)
item = ListItem(List=viz_paths.AllMoves, Index=Slider(411, range=0..412), Wrap=True)
vespidae_to_gcode = VespidaeGcode(Actions=solve_2, Absolute=False)
crv_2 = Curve(item)
panel_2 = Panel(vespidae_to_gcode)
