# Grasshopper definition example_00.gh (Grasshopper 1.0.7)
# plug-ins: Vespidae

number_slider = Slider(0, range=0..10)
geo = Geometry(<brep referenced from the Rhino model>)
slice = SlicerComponent(Brep=geo, LayerHeight=Slider(0.2, range=0..1))  # -> Vespidae_Object_out, graft(SlicedPolys), SlicingPlanes
panel = Panel(slice.SlicedPolys)
sliceroffset = SlicerFriendlyOffset(Curve=slice.SlicedPolys, Distance=Slider(0.4, range=0..1), Amount=Slider(3, range=0..10), OutputPlane=PlaneXY(0, 0, 0))  # -> flatten(Result)
panel_2 = Panel(""";START_OF_HEADER
;HEADER_VERSION:0.1
;FLAVOR:Griffin
;GENERATOR.NAME:Cura_SteamEngine
;GENERATOR.VERSION:4.8.0
;GENERATOR.BUILD_DATE:2020-11-10
;TARGET_MACHINE.NAME:Ultimaker 3 Extended
;EXTRUDER_TRAIN.1.INITIAL_TEMPERATURE: 205
;EXTRUDER_TRAIN.1.MATERIAL.VOLUME_USED:4450
;EXTRUDER_TRAIN.1.MATERIAL.GUID:506c9f0d-e3aa-4bd4-b2d2-23e2425b1aa9
;EXTRUDER_TRAIN.1.NOZZLE.DIAMETER:0.4
;EXTRUDER_TRAIN.1.NOZZLE.NAME:AA 0.4
;BUILD_PLATE.TYPE:glass
;BUILD_PLATE.INITIAL_TEMPERATURE:50
;PRINT.TIME:0
;PRINT.GROUPS:1
;PRINT.SIZE.MIN.X:68.525
;PRINT.SIZE.MIN.Y:6
;PRINT.SIZE.MIN.Z:0.2
;PRINT.SIZE.MAX.X:204
;PRINT.SIZE.MAX.Y:125.597
;PRINT.SIZE.MAX.Z:18
;END_OF_HEADER
;Generated with Cura_SteamEngine 4.8.0
T1
G92 E0
M109 S220
G0 F15000 X9 Y6 Z2
G280
G1 F1500 E-6.5""")
sort_curves = SortCurveComponent(Curves=sliceroffset)
vespextrusion = ExtrusionComponent(Curve=sort_curves, Extrusion=Slider(0.01, range=0..0.01), Speed=1000, Temperature=205, ToolId="t0")
solve = SolveActionsComponent(Actions=vespextrusion, RetractHeight=15)
vespmogcode = Vespmo_Gcode_Component(VESPMO=solve, Header=panel_2)
panel_3 = Panel(vespmogcode)
