# Grasshopper definition example_01.gh (Grasshopper 1.0.7)
# plug-ins: Vespidae

# test different settings on same curve
crv = Curve(<curve referenced from the Rhino model>)
number_slider = Slider(2, range=0..10)
area = Area(Geometry=crv)  # -> Area, Centroid
xy = XYPlane(Origin=area.Centroid)
sqgrid = Square(Plane=xy, Size=Slider(31, range=0..100), ExtentX=number_slider, ExtentY=number_slider)  # -> Cells, Points
vec2pt = Vector2Pt(PointA=area.Centroid, PointB=sqgrid.Points, Unitize=False)  # -> Vector, Length
move = Move(Geometry=crv, Motion=vec2pt.Vector)  # -> flatten(Geometry), Transform
lng = ListLength(List=flatten(move.Geometry))
series = Series(Start=Slider(100, range=0..100), Step=Slider(100, range=0..100), Count=lng)  # -> flatten(Series)
c_script = CSharpScript(x=series)  # -> out, flatten(A); inputs x: list of Int32
# ---------- c_script: C# ----------
var gcode = new List<string>(); 

foreach(var t in x){
    gcode.Add($"M566 X{t} Y{t}"); 
    }

A = gcode;
# ---------- end c_script ----------
vespmove = MoveComponent(Curve=graft(move.Geometry), Speed=Slider(6000, range=0..10000), ToolId="t0", GcodeInjection=graft(c_script.A))  # -> flatten(VespObj)
solve = SolveActionsComponent(Actions=vespmove, RetractHeight=15, TravelSpeed=5000, PartialRetract=Toggle(True))
expose_paths = ExposePaths(Vespmo=solve, ArrowScl=1)  # -> AllMoves, AllTravel, Arrows
vespmogcode = Vespmo_Gcode_Component(VESPMO=solve)
panel = Panel(vespmogcode)
upload_gcode = UploadGcodeComponent(Gcode=vespmogcode, Filename="example_01", Ip="http://192.168.0.10", SendCode=Button())
