# Grasshopper definition example_02.gh (Grasshopper 1.0.7)
# plug-ins: Vespidae

pipeline = GeometryPipeline(
    GroupByLayer=False,
    GroupByType=False,
    IncludeHidden=True,
    IncludeLocked=True,
    LayerFilter="t1",
    NameFilter="*",
    SublayerFiltering=True,
    TypeFilter=4)
pipeline_2 = GeometryPipeline(
    GroupByLayer=False,
    GroupByType=False,
    IncludeHidden=True,
    IncludeLocked=True,
    LayerFilter="t0",
    NameFilter="*",
    SublayerFiltering=True,
    TypeFilter=4)
pt = Point(Point(15, 2, 0))
sort_curves = SortCurveComponent(Curves=pipeline_2)
c_script = CSharpScript(x=pt)  # -> out, A; inputs x: Point3d
# ---------- c_script: C# ----------
var test = new Rhino.Geometry.TextDot("hello", x);
test.Scale(4); 
test.

A = test;
# ---------- end c_script ----------
vespmove = MoveComponent(Curve=sort_curves, Speed=Slider(6000, range=0..10000), ToolId="t0")
vespmove_2 = MoveComponent(Curve=pipeline, Speed=Slider(5400, range=0..10000), ToolId="t1")
merge = Merge(Data1=vespmove, Data2=vespmove_2)
panel = Panel(merge)
solve = SolveActionsComponent(Actions=merge, RetractHeight=Slider(29, range=0..100), TravelSpeed=5000, PartialRetract=False)
panel_2 = Panel(solve)
panel_3 = Panel("""T-1 
G0 X150 Y250""")
expose_paths = ExposePaths(Vespmo=solve, ArrowScl=1)  # -> AllMoves, AllTravel, Arrows
vespmogcode = Vespmo_Gcode_Component(VESPMO=solve, Footer=panel_3)
crv = Curve(expose_paths.AllTravel)
geo = Geometry(expose_paths.Arrows)
panel_4 = Panel(vespmogcode)
upload_gcode = UploadGcodeComponent(Gcode=vespmogcode, Filename="example_02", Ip="http://192.168.0.10", SendCode=Button())
