# Grasshopper definition 04_multitool.gh (Grasshopper 1.0.7)
# plug-ins: Vespidae

pipeline = GeometryPipeline(
    GroupByLayer=False,
    GroupByType=False,
    IncludeHidden=True,
    IncludeLocked=True,
    LayerFilter="kat_material",
    NameFilter="*",
    SublayerFiltering=True,
    TypeFilter=4)
pipeline_2 = GeometryPipeline(
    GroupByLayer=False,
    GroupByType=False,
    IncludeHidden=True,
    IncludeLocked=True,
    LayerFilter="sep_material",
    NameFilter="*",
    SublayerFiltering=True,
    TypeFilter=4)
pipeline_3 = GeometryPipeline(
    GroupByLayer=False,
    GroupByType=False,
    IncludeHidden=True,
    IncludeLocked=True,
    LayerFilter="sep_material",
    NameFilter="*",
    SublayerFiltering=True,
    TypeFilter=4)
infill = InfillComponent(Curve=pipeline, Density=Slider(1.3, range=0.4..10), Offset=Slider(1.1, range=0.2..10))
infill_2 = InfillComponent(Curve=pipeline_2, Density=Slider(1.3, range=0.4..10), Offset=Slider(1, range=0.2..10))
sliceroffset = SlicerFriendlyOffset(Curve=pipeline_3, Distance=Slider(0.4, range=0..1), Amount=Slider(2, range=0..10), Keep=Toggle(True))
number_slider = Slider(2, range=0..10)
Z = UnitZ(Factor=1)
Z_2 = UnitZ(Factor=1)
Z_3 = UnitZ(Factor=1)
arrlinear = LinearArray(Geometry=infill, Direction=Z_2, Count=number_slider)  # -> flatten(Geometry), Transform
arrlinear_2 = LinearArray(Geometry=infill_2, Direction=Z_3, Count=number_slider)  # -> Geometry, Transform
arrlinear_3 = LinearArray(Geometry=sliceroffset, Direction=Z, Count=Slider(2, range=0..10))  # -> flatten(Geometry), Transform
preview = CustomPreview(Geometry=arrlinear.Geometry, Material=ColourSwatch(SwatchColor=RGB(255, 255, 0)))
preview_2 = CustomPreview(Geometry=arrlinear_2.Geometry, Material=ColourSwatch(SwatchColor=RGB(11, 8, 26)))
number_slider_2 = Slider(1, range=0..1)
vespextrusion = ExtrusionComponent(
    Curve=arrlinear_3.Geometry,
    Extrusion=1,
    Speed=Slider(6000, range=0..10000),
    Temperature=205,
    Retract=2,
    ToolId=Slider(0, range=0..1),
    ExtType=0)
vespextrusion_2 = ExtrusionComponent(
    Curve=arrlinear.Geometry,
    Extrusion=1,
    Speed=Slider(5000, range=0..10000),
    Temperature=205,
    Retract=2,
    ToolId=Slider(1, range=0..1),
    ExtType=number_slider_2)
vespextrusion_3 = ExtrusionComponent(
    Curve=arrlinear_2.Geometry,
    Extrusion=1,
    Speed=Slider(6000, range=0..10000),
    Temperature=205,
    Retract=2,
    ToolId=Slider(0, range=0..1),
    ExtType=number_slider_2)
merge = Merge(Data1=vespextrusion, Data2=vespextrusion_3, Data3=vespextrusion_2)  # -> flatten(Result)
additivesolver = AdditiveSolver(Actions=merge, RetractHeight=Slider(40, range=0..100), TravelSpeed=5000, PartialRetract=False, SortCriteria=0)
vespmogcode = Vespmo_Gcode_Component(Actions=additivesolver)
panel = Panel(additivesolver)
upload_gcode = UploadGcodeComponent(Gcode=vespmogcode, Filename="04_multitool", Ip="http://192.168.0.10", SendCode=Button())
panel_2 = Panel(vespmogcode)
viz_paths = VisualizePaths(Actions=additivesolver, ArrowScl=1, ArrowDensity=1)  # -> AllMoves, Moves, Extrude, Travel, Arrows
item = ListItem(List=viz_paths.AllMoves, Index=Slider(19, range=0..30), Wrap=True)
